# Grasshopper definition export_hops.ghx (Grasshopper 1.0.8)
# plug-ins: Increment

py3 = Python3Script(unload=Button())  # inputs unload: Boolean
# ---------- py3: Python ----------
from compas_rhino import unload_modules

import easyhops
if unload:
    unload_modules("easyhops")
# ---------- end py3 ----------

increment = Increment(BeginningNumber=0, StepSize=1, currentValue=1, increment=1, oldStart=0)  # -> Output, Item
list = ValueList({"main_primary", "primary", "secondary", "tertiary", "shoe"}, selected="shoe")
list_2 = ValueList({"zero": 0, "1", "2", "3", "4"}, selected="zero")
btlx = Button()
hops = Button()
path = FilePath("C:\Users\kapso\GitHub\llhil-t2-fabrication\design\modularization\data\260601_v1_fabrication_model_0.json")
py3_2 = Python3Script(filepath=path, level=list_2, index=increment.Output, write=btlx, export=hops)  # -> out, geometry, processing_report, HOPSJob; inputs filepath: String, hierarchy: String, level: Int32, index: Int32, export: Boolean
# ---------- py3_2: Python ----------
import os, sys, importlib
import copy
from compas.scene import Scene
from compas_timber.model import TimberModel
from compas_timber.fabrication import BTLxWriter
from compas_rhino.conversions import plane_to_rhino
import compas_timber

gh_dir = os.path.dirname(ghenv.Component.OnPingDocument().FilePath)

repo_root = os.path.dirname(os.path.dirname(gh_dir))
cnc_dir = os.path.join(repo_root, "fabrication", "cnc")
# if hierarchy:
#     name = str(hierarchy)
# elif level:
#     name = "level_" + str(level)
name = "level_0"
btlx_dir = cnc_dir + "\\BTLx\\" + name
hops_dir =cnc_dir + "\\HOPS\\" + name

if cnc_dir not in sys.path:
    sys.path.insert(0, cnc_dir)

import hops_exporter as he
importlib.reload(he)


scene = Scene()
model_scene = Scene()

model = he.load_model(filepath)

export_dir = os.path.join(os.path.dirname(filepath), "hops")
beam = he.resolve_beam(model, index, hierarchy, level)

if beam:
    he.override_features(beam)
    if beam.attributes.get("hierarchy") != "shoe":
        geometry = he.visualize_geometry(beam)
        processing_report = he.get_processing_report(beam)

if write:
    new_model = TimberModel()
    for beam in model.beams:
        # if hierarchy:
        #     if beam.attributes.get("hierarchy") == hierarchy:
        #         new_model.add_element(beam)
        # if level:
        if beam.attributes.get("level") == level and beam.attributes.get("hierarchy") != "shoe":
            new_model.add_element(beam)
    writer = BTLxWriter()
    xml = writer.write(new_model, file_path=btlx_dir)

if export:
    HOPSJob = he.export_hop(beam, hops_dir)
# ---------- end py3_2 ----------
panel = Panel(py3_2.processing_report)
panel_2 = Panel(py3_2.out)
py3_3 = Python3Script(unload=Button())  # -> out
# ---------- py3_3: Python ----------
from compas_rhino import unload_modules
import compas_timber

if unload:
    unload_modules("compas_timber")
    print("Succesfully unloaded CT!")
# ---------- end py3_3 ----------
panel_3 = Panel(py3_3)
